vi "Main.gviweb"   [LabVIEW NXG 3.0.0]
panel controls:
  "Run Sequence": bool
  "Simulate Failure": enum{"None", "Keyboard", "Video", "Power"} = "None"
  "Amplitude": f64 = 10
  "Automatically pick a system": bool
  "System": i32
  "Test": i32
panel indicators:
  "Data Grid": T1[]
  "Parameters": i32
types:
  T1 = cluster{"System": string, "Connection": string, "Test Program": string, "UUT": string, "Status": string, "Last Updated": string, "Queue": f64}
uses:
  NI::Skyline::Configuration::Open Configuration.gvi
  WebApp::Pick System.gviweb
  WebApp::Get Minion ID.gviweb
  WebApp::Filter Systems by Package.gviweb
  WebApp::Get Tester Status.gviweb
diagram:
  w1 = FALSE  # Development
  case (w1) {
    frame False, Default {
      # Set Development boolean to False in order to
      # clear server, username, and password
      # before building and deploying the application
      # to your web server or SystemLink.
      w5 = ""  # Server
      w6 = ""  # Username
      w7 = ""  # Password
      w2 = w7
      w3 = w6
      w4 = w5
    }
    frame True {
      # Set Development boolean to True and
      # change the server, username, and password
      # to match your web server.  Also, ensure that CORS
      # is enabled on your web server before trying to
      # interactively run your application from within NXG.
      w8 = ""  # Server
      w9 = "admin"  # Username
      w10 = ""  # Password
      w2 = w10
      w3 = w9
      w4 = w8
    }
  }
  call "Open Configuration.gvi"(server url=w4, username=w3, password=w2) -> (configuration=w11)
  call "Test Plans.gviweb"(Input=reference to "Test") -> (Test Plans=w12, Error Out=w13)
  s1 = 1  # shift register
  while (after w13) {
    event (timeout = s1) {
      on "Run Sequence" Value changed {
        Property Node(instance in=reference to "Test") -> ("Value"=w14)
        Array Index(array=w12) -> (out0[w14]=w15)
        Property Node(instance in=w15) -> ("Test"=w16)
        # Sequence must be some where in the TestStand path like C:\Users\Public\Documents\TestSequences
        case ($"Automatically pick a system") {
          frame True {
            call "Pick System.gviweb"(configuration in=w11, sequence=w16) -> (configuration out=w18, minion id=w17)
          }
          frame False {
            Property Node(instance in=reference to "System") -> ("Items"=w19)
            Array Index(array=w19) -> (out0[$System]=w20)
            call "Get Minion ID.gviweb"(configuration in=w11, hostname=w20) -> (configuration out=w18, id=w17)
          }
        }
        case (w16) {
          frame Default {
            w21 = "[]"
          }
          frame "Computer Motherboard Tests.seq" {
            case ($"Simulate Failure") {
              frame "None", Default {
                w21 = ""
              }
              frame "Keyboard" {
                w21 = "Keyboard=5"
              }
              frame "Video" {
                w21 = "Video=12"
              }
              frame "Power" {
                w21 = "PowerFail=True"
              }
            }
          }
          frame "Power Test.seq" {
            Number To Fractional String(number=$Amplitude, precision (6)=2) -> (F-format string=w22)
            Concatenate Strings("Amplitude=", w22) -> w21
          }
        }
        Concatenate Strings("Email=", "joshua.prewitt@ni.com") -> w23
        Build Array(w21, w23) -> w24
        Flatten To JSON(anything=w24) -> (JSON string=w25)
        call "Run Sequence.gviweb"(configuration=w18, minion ID=w17, sequence=w16, args=w25, timeout=600)
      }
      on "Test" Value changed; Timeout {
        Array Index(array=w12) -> (out0[$Test]=w26)
        Property Node(instance in=w26) -> ("Package"=w27)
        call "Filter Systems by Package.gviweb"(configuration in=w11, package=w27) -> (systems=w28)
        for {
          w29 = each element of w28
          Property Node(instance in=w29) -> ("grains:data:host"=w31)
          append w31 to w30
        }
        Sort 1D Array(array=w30) -> (sorted array=w32)
        Property Node(instance in=reference to "System", "Items"=w32)
        $Parameters <- $Test
      }
      on "Automatically pick a system" Value changed {
        Event Data() -> ("New Value"=w33)
        Property Node(instance in=reference to "System", "Disabled"=w33)
      }
    }
    next s1 = -1
    stop if FALSE
  }
  while {
    Wait(time to wait=1000)
    call "Get Tester Status.gviweb"(Configuration=w11) -> (Testers=w34)
    $"Data Grid" <- w34
    stop if FALSE
  }
