vi "Active Jobs.gviweb"   [LabVIEW NXG 3.1.0]
inputs:
  "configuration in": "Configuration.gtype"
  "minion id": string
  "error in": error
outputs:
  "configuration out": "Configuration.gtype"
  "jobs in progress": i32
  "error out": error
  "minion id out": string
types:
  "Client Handle.gtype" = u32
  "Configuration.gtype" = cluster{"Server URL": string, "Session": "Client Handle.gtype"}
  T1 = cluster{"count": i32, "data": cluster{"id": string, "state": string}[]}
uses:
  NI::HTTP::POST Buffer.gvi
diagram:
  $"configuration out" <- $"configuration in"
  $"minion id out" <- $"minion id"
  Property Node(instance in=$"configuration in") -> ("Session"=w1, "Server URL"=w2)
  Concatenate Strings(w2, "/nisysmgmt/v1/query-jobs") -> w3
  w4 = "\\\") && (state==\\\"INQUEUE\\\" || state==\\\"INPROGRESS\\\"))\",\n   \"projection\": \"new(id,state)\"\n}"
  Concatenate Strings("{  \n   \"filter\": \"((id==\\\"", $"minion id", w4) -> w5
  call "POST Buffer.gvi"(client handle=w1, url=w3, buffer=w5, error in=$"error in") -> (body=w6, error out=w7)
  Unflatten From JSON(JSON string=w6, default null elements=TRUE, type and defaults=T1 {all zero or empty}) -> (value=w8)
  Property Node(instance in=w8) -> ("count"=w9)
  $"jobs in progress" <- w9
  $"error out" <- w7
