vi "Filter Systems by Package.gviweb"   [LabVIEW NXG 2.1.0]
inputs:
  "configuration in": "Configuration.gtype"
  "package": string
  "error in": error
outputs:
  "Output": string[]
  "error out": error
  "configuration out": "Configuration.gtype"
types:
  "Client Handle.gtype" = u32
  "Configuration.gtype" = cluster{"Server URL": string, "Session": "Client Handle.gtype"}
  T1 = cluster{"id": string, "_id": cluster{"$oid": string}}
uses:
  NI::HTTP::POST Buffer.gvi
diagram:
  $"configuration out" <- $"configuration in"
  Property Node(instance in=$"configuration in") -> ("Session"=w1, "Server URL"=w2)
  Concatenate Strings(w2, "/nisysmgmt/v1/systems/managed/query") -> w3
  w4 = "\" : {\"$exists\" : true }\n   },\n   \"projection\":{  \n      \"id\":true\n   }\n}"
  Concatenate Strings("{  \n   \"filter\":{ \"packages.data.", $package, w4) -> w5
  call "POST Buffer.gvi"(client handle=w1, url=w3, buffer=w5, error in=$"error in") -> (body=w6, error out=w7)
  w8 = cluster{"status_code": i32, "result": T1[]} {all zero or empty}
  Unflatten From JSON(JSON string=w6, default null elements=TRUE, error in (no error)=w7, type and defaults=w8) -> (error out=w9, value=w10)
  Property Node(instance in=w10) -> ("result"=w11)
  for {
    w12 = each element of w11
    Property Node(instance in=w12) -> ("id"=w14)
    append w14 to w13
  }
  $Output <- w13
  $"error out" <- w9
