vi "Get Minion ID.gviweb"   [LabVIEW NXG 3.1.0]
inputs:
  "hostname": string
  "configuration in": "Configuration.gtype"
  "error in": error
outputs:
  "id": string
  "configuration out": "Configuration.gtype"
  "error out": error
panel indicators:
  "body": string
types:
  "Client Handle.gtype" = u32
  "Configuration.gtype" = cluster{"Server URL": string, "Session": "Client Handle.gtype"}
uses:
  NI::HTTP::POST Buffer.gvi
diagram:
  $"configuration out" <- $"configuration in"
  Property Node(instance in=$"configuration in") -> ("Session"=w1, "Server URL"=w2)
  Concatenate Strings(w2, "/nisysmgmt/v1/query-systems") -> w3
  Concatenate Strings("{  \n  \"filter\": \"alias==\\\"", $hostname, "\\\"\",\n  \"projection\": \"new(id)\"\n}") -> w4
  call "POST Buffer.gvi"(client handle=w1, url=w3, buffer=w4, error in=$"error in") -> (body=w5, error out=w6)
  $body <- w5
  Unflatten From JSON(JSON string=w5, default null elements=TRUE, error in (no error)=w6, type and defaults=cluster{"data": cluster{"id": string}[]} {all zero or empty}) -> (error out=w7, value=w8)
  Property Node(instance in=w8) -> ("data"=w9)
  Array Index(array=w9) -> (out0[_]=w10)
  Property Node(instance in=w10) -> ("id"=w11)
  $id <- w11
  $"error out" <- w7
