vi "Get Tester Status.gviweb"   [LabVIEW NXG 2.1.0]
inputs:
  "Configuration": "Configuration.gtype"
outputs:
  "Testers": T1[]
types:
  T1 = cluster{"System": string, "Test Program": string, "UUT": string, "Status": string, "Last Updated": string, "Queue": f64}
  "Client Handle.gtype" = u32
  "Configuration.gtype" = cluster{"Server URL": string, "Session": "Client Handle.gtype"}
  "DataType.gtype" = enum{"Double", "I32", "String", "Boolean", "U64", "Timestamp"}
  "Tag.gtype" = cluster{"Path": string, "Datatype": "DataType.gtype", "Configuration": "Configuration.gtype"}
uses:
  NI::Skyline::TagHTTP::Query Tags.gvi
  NI::Skyline::TagHTTP::Multi Read.gvi
  NI::Skyline::TagHTTP::Read Tag Settings.gvi
  WebApp::Get Prop.gviweb
  WebApp::Active Jobs.gviweb
  NI::Skyline::TagHTTP::Close Tag (Multiple).gvi
diagram:
  call "Query Tags.gvi"(paths=["*TestMonitor*"], configuration=$Configuration) -> (tags=w1, error out=w2)
  call "Multi Read.gvi"(tags in=w1, error in=w2) -> (tags out=w3, tag clusters=w4, error out=w5)
  s1 = "Tag.gtype"[] []  # shift register
  for {
    w6 = each element of w3
    w7 = each element of w4
    call "Read Tag Settings.gvi"(tag in=w6, error in=w5) -> (tag out=w9, properties=w10, error out=w11)
    Build Array[ConcatenateInputs=True](s1, w9) -> w12
    Property Node(instance in=w7) -> ("Value"=w13, "Time Stamp"=w14, "Path"=w15)
    Format Date Time String(time stamp=w14) -> (date/time string=w16)
    call "Get Prop.gviweb"(properties=w10, key="nitmHostname") -> (value=w17)
    call "Get Prop.gviweb"(properties=w10, key="nitmProgramName") -> (value=w18)
    call "Get Prop.gviweb"(properties=w10, key="nitmSerialNumber") -> (value=w19)
    Search Or Split String(search string/char=".", string=w15) -> (substring before match=w20)
    call "Active Jobs.gviweb"(configuration in=$Configuration, minion id=w20) -> (jobs in progress=w21)
    Build Cluster(w17, w18, w19, w13, w16, w21) -> w22
    call "Get Prop.gviweb"(properties=w10, key="nitmSerialNumber")
    append w22 to w8
    next s1 = w12
  }
  call "Close Tag (Multiple).gvi"(tags=s1, error in=w11)
  $Testers <- w8
