vi "Main.gviweb"   [LabVIEW NXG 3.1.0]
panel controls:
  "Run Sequence": bool
  "Simulate Failure": enum{"None", "Keyboard", "Video", "Power"} = "None"
  "Amplitude": f64 = 10
  "Automatically pick a system": bool
  "System": i32
  "Test": i32
  "Email": string
  "Manufacturing Failure": enum{"None", "Noise", "LED", "Power"} = "None"
panel indicators:
  "Data Grid": T1[]
  "Parameters": i32
types:
  T1 = cluster{"System": string, "Connection": string, "Test Program": string, "UUT": string, "Status": string, "Last Updated": string, "Queue": f64}
uses:
  NI::Skyline::Configuration::Open Configuration.gvi
  WebApp::Get Tester Status.gviweb
  WebApp::Pick System.gviweb
  WebApp::Get Minion ID.gviweb
  WebApp::Filter Systems by Package.gviweb
diagram:
  w1 = FALSE  # Development
  case (w1) {
    frame False, Default {
      # Set Development boolean to False in order to
      # clear server, username, and password
      # before building and deploying the application
      # to your web server or SystemLink.
      w5 = ""  # Server
      w6 = ""  # Username
      w7 = ""  # Password
      w2 = w7
      w3 = w6
      w4 = w5
    }
    frame True {
      # Set Development boolean to True and
      # change the server, username, and password
      # to match your web server.  Also, ensure that CORS
      # is enabled on your web server before trying to
      # interactively run your application from within NXG.
      w8 = "http://server"  # Server
      w9 = "admin"  # Username
      w10 = ""  # Password
      w2 = w10
      w3 = w9
      w4 = w8
    }
  }
  call "Open Configuration.gvi"(server url=w4, username=w3, password=w2) -> (configuration=w11, error out=w12)
  while {
    call "Get Tester Status.gviweb"(Configuration=w11, error in=no error) -> (Testers=w13)
    $"Data Grid" <- w13
    Wait(time to wait=1000)
    stop if FALSE
  }
  call "Test Plans.gviweb"(Input=reference to "Test", error in=w12) -> (Test Plans=w14, Error Out=w15)
  s1 = 1  # shift register
  while {
    event (timeout = s1) {
      on "Run Sequence" Value changed {
        Property Node(instance in=reference to "Test") -> ("Value"=w16)
        Array Index(array=w14) -> (out0[w16]=w17)
        Property Node(instance in=w17) -> ("Test"=w18)
        # Sequence must be some where in the TestStand path like C:\Users\Public\Documents\TestSequences
        case ($"Automatically pick a system") {
          frame True {
            call "Pick System.gviweb"(configuration in=w11, sequence=w18, error in=w15) -> (configuration out=w20, minion id=w19, error out=w21)
          }
          frame False {
            Property Node(instance in=reference to "System") -> ("Items"=w22)
            Array Index(array=w22) -> (out0[$System]=w23)
            call "Get Minion ID.gviweb"(configuration in=w11, hostname=w23, error in=w15) -> (configuration out=w20, id=w19, error out=w21)
          }
        }
        case (w18) {
          frame Default {
            w24 = "[]"
          }
          frame "Computer Motherboard Tests.seq" {
            case ($"Simulate Failure") {
              frame "None", Default {
                w24 = ""
              }
              frame "Keyboard" {
                w24 = "Keyboard=5"
              }
              frame "Video" {
                w24 = "Video=12"
              }
              frame "Power" {
                w24 = "PowerFail=True"
              }
            }
          }
          frame "Manufacturing Test.seq" {
            case ($"Manufacturing Failure") {
              frame "None", Default {
                w24 = ""
              }
              frame "Noise" {
                w24 = "FailNoiseToleranceTest=True"
              }
              frame "LED" {
                w24 = "FailLEDTest=True"
              }
              frame "Power" {
                w24 = "Fail24VPowerCheck=True"
              }
            }
          }
          frame "Power Test.seq" {
            Number To Fractional String(number=$Amplitude, precision (6)=2) -> (F-format string=w25)
            Concatenate Strings("Amplitude=", w25) -> w24
          }
        }
        Concatenate Strings("EmailAddress=", $Email) -> w26
        Build Array(w24, w26) -> w27
        Flatten To JSON(anything=w27) -> (JSON string=w28)
        call "Run Sequence.gviweb"(configuration=w20, minion ID=w19, sequence=w18, args=w28, error in=w21, timeout=600) -> (error out=w29)
      }
      on "Test" Value changed; Timeout {
        Array Index(array=w14) -> (out0[$Test]=w30)
        Property Node(instance in=w30) -> ("Package"=w31)
        call "Filter Systems by Package.gviweb"(configuration in=w11, package=w31) -> (systems=w32)
        for {
          w33 = each element of w32
          Property Node(instance in=w33) -> ("grains:data:host"=w35)
          append w35 to w34
        }
        Sort 1D Array(array=w34) -> (sorted array=w36)
        Property Node(instance in=reference to "System", "Items"=w36)
        $Parameters <- $Test
      }
      on "Automatically pick a system" Value changed {
        Event Data() -> ("New Value"=w37)
        Property Node(instance in=reference to "System", "Disabled"=w37)
      }
    }
    next s1 = -1
    stop if FALSE
  }
