vi "Pick System.gviweb"   [LabVIEW NXG 2.1.0]
inputs:
  "configuration in": "Configuration.gtype"
  "sequence": string
  "error in": error
outputs:
  "configuration out": "Configuration.gtype"
  "minion id": string
  "queue size": i32
  "error out": error
types:
  "Client Handle.gtype" = u32
  "Configuration.gtype" = cluster{"Server URL": string, "Session": "Client Handle.gtype"}
uses:
  WebApp::Get Package Name.gviweb
  WebApp::Active Jobs.gviweb
diagram:
  call "Get Package Name.gviweb"(sequence=$sequence) -> (package=w1)
  call "Filter Systems by Package.gviweb"(configuration in=$"configuration in", package=w1, error in=$"error in") -> (configuration out=w2, Output=w3, error out=w4)
  s1 = 2147483647  # shift register
  s2 = ""  # shift register
  s3 = w4  # shift register
  for {
    w5 = each element of w3
    call "Active Jobs.gviweb"(configuration in=w2, minion id=w5, error in=s3) -> (configuration out=w6, minion id out=w7, jobs in progress=w8, error out=w9)
    Is Less(x=w8, y=s1) -> w10
    case (w10) {
      frame False, Default {
        w11 = s2
        w12 = s1
      }
      frame True {
        w11 = w7
        w12 = w8
      }
    }
    next s1 = w12
    next s2 = w11
    next s3 = w9
  }
  $"configuration out" <- w6
  $"minion id" <- s2
  $"queue size" <- s1
  $"error out" <- s3
