vi "Run Sequence.gviweb"   [LabVIEW NXG 3.1.0]
inputs:
  "configuration": "Configuration.gtype"
  "minion ID": string = "NI_PXIe-8133_Embedded_Controller--MAC-00-80-2F-12-7F-31"
  "sequence": string = "Computer Motherboard Tests.seq"
  "timeout": u32 = 600
  "args": string = "[\"PowerFail=True\",\"EmailAddress=\"]"
  "error in": error
outputs:
  "error out": error
panel indicators:
  "POST Request": string
  "body": string
  "headers": string
types:
  "Client Handle.gtype" = u32
  "Configuration.gtype" = cluster{"Server URL": string, "Session": "Client Handle.gtype"}
uses:
  WebApp::Encode.gviweb
  NI::HTTP::POST Buffer.gvi
diagram:
  Property Node(instance in=$configuration) -> ("Session"=w1, "Server URL"=w2)
  Concatenate Strings(w2, "/nisysmgmt/v1/jobs") -> w3
  w4 = "\"\n   ],\n   \"metadata\":{  \n      \"queued\":true,\n      \"timeout\":"
  w5 = "\n   },\n   \"fun\":[\"niteststand_remote_executor.execute\"],\n   \"arg\":[[\""
  Format Into String(formatString="%d", $timeout) -> w6
  call "Encode.gviweb"(string input=$sequence) -> (string output=w7)
  Concatenate Strings("{  \n   \"tgt\":[  \n      \"", $"minion ID", w4, w6, w5, w7, "\",", $args, "   ]]\n}") -> w8
  call "POST Buffer.gvi"(client handle=w1, url=w3, buffer=w8, error in=$"error in") -> (headers=w9, body=w10, error out=w11)
  $headers <- w9
  $body <- w10
  $"error out" <- w11
  $"POST Request" <- w8
